# Dynamo graph duct_loss latest.dyn (Dynamo 2.12.0.5650)
# packages: MEPover 2022.1.1

python_script = Python()  # IronPython2
# ---------- python_script.python (16 lines) ----------
import clr
clr.AddReference('ProtoGeometry')
from Autodesk.DesignScript.Geometry import *

clr.AddReference('DynamoRevitDS')
import Dynamo
#access to the current Dynamo instance and workspace
dynamoRevit = Dynamo.Applications.DynamoRevit()
currentWorkspace = dynamoRevit.RevitDynamoModel.CurrentWorkspace

def onEvaluationcompleted(obj, e):
	for i in currentWorkspace.Nodes:
		if i.Name.StartsWith("*Force"):
			i.MarkNodeAsModified(True)
#the handlers for when a script has been run
currentWorkspace.EvaluationCompleted += onEvaluationcompleted
# ----------------------------------------
python_script_2 = Python()  # CPython3
# ---------- python_script_2.python (5 lines) ----------
import os
username = os.path.expanduser('~')
path = username + "\\AppData\\Local\\Temp\\ductloss.csv"

OUT = path
# ----------------------------------------
code_block = CodeBlock { [["System Type", "Width", "Height", "Diameter", "Length", "Item Description"]]; }
# note: https://forum.dynamobim.com/t/how-to-force-nodes-to-rerun-without-changes-when-nodes-rerun/56366/3
force_get_active_selection = Python()  # IronPython2
# ---------- force_get_active_selection.python (20 lines) ----------
import clr


clr.AddReference('RevitServices')
import RevitServices
from RevitServices.Persistence import DocumentManager
from RevitServices.Transactions import TransactionManager

doc = DocumentManager.Instance.CurrentDBDocument
uidoc=DocumentManager.Instance.CurrentUIApplication.ActiveUIDocument


def get_current_selection (uidoc):
	sel = uidoc.Selection
	return sel.GetElementIds()
	
selected_elements = []
for i in get_current_selection(uidoc):
	selected_elements.insert(0, doc.GetElement(i))
OUT = selected_elements, get_current_selection (uidoc)
# ----------------------------------------
code_block_2 = CodeBlock(x=force_get_active_selection) { x[0]; }
python_script_3 = Python(IN[0]=code_block_2)  # CPython3
# ---------- python_script_3.python (38 lines) ----------
#Subscribe to my YouTube: https://www.youtube.com/c/TheBIMCoordinator/featured
#Follow me on LinkedIn: https://www.linkedin.com/in/dalton-goodwin-067a07107/

"""
Dynamo Core Assemblies: 
https://www.nuget.org/packages/DynamoVisualProgramming.Core/2.13.1.3887
Revit API: 
https://www.revitapidocs.com/2020/d4648875-d41a-783b-d5f4-638df39ee413.htm
"""

"""
C:\Program Files\Autodesk\Revit 2022\AddIns\DynamoForRevit
C:\Program Files\Autodesk\Revit 2022\AddIns\DynamoForRevit\Revit
"""


import os
#Preparing input from dynamo to revit
ele = UnwrapElement(IN[0])

#Gets username and create path to save data
username = os.path.expanduser('~')
path = username + "\\AppData\\Local\\Temp\\"

#First condition checks how many elements are selected. If only one element is selected it will write the element id to the txt file.
if len(ele) == 1:
    file = open(path + "ductlossTemp.txt", "w") 
    file.write(ele[0].Id.ToString()) 
    file.close()
    OUT = "Single element has been written to a temp text file. Now select your elements and run again."
#Second condition checks how many elements are selected. If greater than one it will return the element id from the txt file. The reason is so we know what is the first duct element in the system.
elif len(ele) > 1:
    with open (path + "ductlossTemp.txt", "r") as myfile:
        data = myfile.read().splitlines()
        OUT = data[0] 	
#If nothing is selected it will return the string below. The script can't do anything if nothing is selected.
else:
	OUT = "Nothing selected."
# ----------------------------------------
element_by_id = ElementById(Id=python_script_3)
contains = List.Contains(list=code_block_2@L1, item=element_by_id)
filterByBoolMask = List.FilterByBoolMask(list=code_block_2, mask=contains)
flatten = List.Flatten(list=filterByBoolMask.in)
code_block_3 = CodeBlock(x=flatten) { x[0]; }
id = Element.Id(element=code_block_3)
id_2 = Element.Id(element=filterByBoolMask.out)
mep_connector_info = Custom[MEP connector info](Element=filterByBoolMask.out)  # package MEPover; Returns location, connector info and connected elements
id_3 = Element.Id(element=mep_connector_info.ConnectedElements)
python_script_4 = Python(IN[0]=id, IN[1]=id_2, IN[2]=id_3)  # CPython3
# ---------- python_script_4.python (37 lines) ----------
#Preparing input from dynamo to revit

first_ele = IN[0] #First element in the system. This helps with the order of the elements.
rest_ele = IN[1] #Rest of the elements from the selection.
connector_ele = IN[2] #Elements from the connectors

"""
This is getting the list length. Count of how many elements are in the list.
The length is used to prevent the while loop from running forever. 
"""
dup = len(connector_ele)+1

#We are creating our OUT list with the first element already in it. We will add the rest of the elements through the below while loop. 
OUT = [first_ele]


x = 0 #This var is used to check against the dup length. The loop will run while x is less than dup.
while x < dup:
    
    #The first condition here is checking the first element. This should only be ran once.
    if len(OUT) == 1:
        for index, c in enumerate(connector_ele):
            if first_ele in c:
                connector_ele.pop(index)
                OUT.append(rest_ele.pop(index))
                break
           
    else:    
        last_ele = OUT[-1]#We are using this last var in the OUT list to check against the rest of the elements so we can find the next element. 
        for index, c in enumerate(connector_ele):
            if last_ele in c:
                connector_ele.pop(index)
                OUT.append(rest_ele.pop(index))
                break
    x += 1
            
            
# ----------------------------------------
element_by_id_2 = ElementById(Id=python_script_4)
code_block_4 = CodeBlock { "System Type"; }
getParameterValueByName = Element.GetParameterValueByName(element=element_by_id_2, parameterName=code_block_4)
code_block_5 = CodeBlock { "Type Name"; }
getParameterValueByName_2 = Element.GetParameterValueByName(element=getParameterValueByName, parameterName=code_block_5)
code_block_6 = CodeBlock { "Width"; }
getParameterValueByName_3 = Element.GetParameterValueByName(element=element_by_id_2, parameterName=code_block_6)
string_from_object = FromObject(object=getParameterValueByName_3)
code_block_7 = CodeBlock { "Height"; }
getParameterValueByName_4 = Element.GetParameterValueByName(element=element_by_id_2, parameterName=code_block_7)
string_from_object_2 = FromObject(object=getParameterValueByName_4)
code_block_8 = CodeBlock { "Diameter"; }
getParameterValueByName_5 = Element.GetParameterValueByName(element=element_by_id_2, parameterName=code_block_8)
string_from_object_3 = FromObject(object=getParameterValueByName_5)
code_block_9 = CodeBlock { "Length"; }
getParameterValueByName_6 = Element.GetParameterValueByName(element=element_by_id_2, parameterName=code_block_9)
name = Element.Name(element=element_by_id_2)
code_block_10 = CodeBlock { "Angle"; }
getParameterValueByName_7 = Element.GetParameterValueByName(element=element_by_id_2, parameterName=code_block_10)
python_script_5 = Python(IN[0]=name, IN[1]=getParameterValueByName_7)  # CPython3
# ---------- python_script_5.python (30 lines) ----------
# Load the Python Standard and DesignScript Libraries
import sys
import clr
clr.AddReference('ProtoGeometry')
from Autodesk.DesignScript.Geometry import *

# The inputs to this node will be stored as a list in the IN variables.
duct_types = IN[0]
rads = IN[1]


dts = {"Radius Elbows / Taps" : "Straight Duct", "Mitered Elbows / Taps" : "Straight Duct", "45 Degree" : "Transition (60°)", "60 Degree" : "Transition (60°)"}


OUT = []
# Place your code below this line
for rad, duct_type in zip(rads, duct_types):
    if rad:
        angle = str(int(rad))
        standared = angle + "° Elbow - Mitered with Vanes"
        one_W = angle + "° Elbow, 1x Radius"
        one5_W = angle + "° Elbow - 1.5x Radius"
        one_D = angle + "° Elbow - 3 Gore"
        one5_D = angle + "° Elbow - 5 Gore, 1.5x radius"
        dts_elbows = {"Standard" : standared, "1 W" : one_W, "1.5 W" : one5_W, "1 D" : one_D, "1.5 D" : one5_D}
        OUT.append(dts_elbows[duct_type])
    else:
        OUT.append(dts[duct_type])
		
		
# ----------------------------------------
list_create = List.Create(item0=getParameterValueByName_2, item1=string_from_object, item2=string_from_object_2, item3=string_from_object_3, item4=getParameterValueByName_6, item5=python_script_5)
transpose = List.Transpose(lists=list_create)
join = List.Join(list0=code_block, list1=transpose)
exportCSV = Data.ExportCSV(filePath=python_script_2, data=join)
